# Grasshopper definition fm-gh-bedrock-generator.gh (Grasshopper 1.0.7)
# plug-ins: LunchBox

# fm-bedrock-generator
image = ImageSampler(
    FilePath="C:\Users\MKs\OneDrive - NGI\Grasshopper\GH_FM-bedrock-generator\fm-logo.jpg",
    Filter="Colour",
    Interpolate=True,
    Umax=400,
    Umin=1,
    Vmax=400,
    Vmin=1,
    Wrap=0)

# ----
# A script that connects to the FM data API and generates
# a interpolated bedrock surface mesh and 3D borehole columns.
# 
# To run the script:
# 
# 1) enter the project number
# 
# 2) paste API token from
# app.fieldmanager.io/developer
# 
# For more detailed info - check out the readme in the git repo
# INPUT
project_external_id = Panel("20210119")
insert_token_here = Panel("eyJhbGciOiJSUzI1NiIsInR5cCIgOiAiSldUIiwia2lkIiA6ICJJQ0M2SlM1YVhIb0h6U0VpMEgwNWhnYkkzMDctRjUyWi03dlltWTVJS2swIn0.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.2pXKzN810B9CiflW_LpxCP8pb8QTXFhi8g83YNyFgn2GRM88vMH7W0stYEcix1ZNmftTsAhocO3asD4KcDmFCtztTu6WfDJmzXqD4-tVJtRPTtM7Uo2q_9MtLQIcpD65kDoodviw446fAKRh6g48r1lzs1sWq7JZ5sauD-TPIOBUt1tbLTNaSj1Vyd6HQYCDWA0S6SSzfyfoWlV8yiCvvsEgxNs5895Lq9vRZtsKIVb51QCzuwgKlcEO4EorD4-S9EedDah9beOOgNEpEIq-A7SutnWC-N9MJs4-6_gYlSNIqJiZu4AL8e8pVir4acNaliVMpUwi6GZnay1YOqCeNg")

# ----
# Changelog: 0.1.0
# Initial release.
# There is likely bugs in this code!
# 
# 0.1.1
# Updated for index for depth_soil and depth_rock, added query to API call (limit=10000)
# 
# 0.1.2
# Updated index picking in the locations endpoint
contributors = Panel("Mats Kahlström (NGI)")
# v.0.1.2
licence_usage = Panel("MIT Licence")

# ---- group: GET Project and Project Summary API calls
txt = Text(project_external_id)
token = Data(insert_token_here)
get_project_id = GETProject_id(external_id=txt, token=token)
project_id = Data(get_project_id)
get_project_summary = GETProjectSummary(project_id=project_id, token=token)  # -> location_keys_2, location_vals_2, methods_json_2
panel = Panel(project_id)
methods_json = Data(get_project_summary.methods_json_2)
location_keys = Data(get_project_summary.location_keys_2)
location_vals = Data(get_project_summary.location_vals_2)

# ---- group: Create location points
location_vals_2 = Data(location_vals)
index_picker = Panel("""0
3
4
5
6""")
item = ListItem(List=location_vals_2, Index=index_picker, Wrap=True)
Y = ListItem(List=item, Index="3", Wrap=True)
name = ListItem(List=item, Index="0", Wrap=True)
X = ListItem(List=item, Index="2", Wrap=True)
z_terrain = ListItem(List=item, Index="4", Wrap=True)
pt = ConstructPoint(XCoordinate=X, YCoordinate=Y, ZCoordinate=z_terrain)
location_xyz_points = Data(pt)
location_id = Data(name)

# ---- group: Unpack Methods JSON
methods_json_2 = Data(methods_json)
unpack_json = UnpackJSON(methods_json=methods_json_2)  # -> methods_keys_2, methods_strings_2, methods_vals_2
methods_strings = Data(unpack_json.methods_strings_2)
methods_keys = Data(unpack_json.methods_keys_2)
methods_vals = Data(unpack_json.methods_vals_2)

# ----
index_picker_2 = Panel(location_keys)

# ----
# BODY
index_picker_3 = Panel("""location_id
name
point_easting
point_northing
point_z""")
name_2 = ListItem(List=item, Index="1", Wrap=True)
panel_2 = Panel("""method_id
method_type_id
method_status_id
depth_in_soil
depth_in_rock""")
name_3 = Data(name_2)
name_4 = Data(name_3)
location_id_2 = Data(location_id)
radius_of_3d_column_m = Panel("0.5")

# ---- group: Pick Method = Total Sounding & Conducted Status = Approved OR Conducted
methods_values = Data(methods_vals)
panel_3 = Panel("""0
1
2
5
6""")
item_2 = ListItem(List=methods_values, Index=panel_3, Wrap=True)
pick_method = ValueList({"Total Sounding": 2}, selected="Total Sounding")
item_3 = ListItem(List=item_2, Index=1, Wrap=True)
item_4 = ListItem(List=item_2, Index=2, Wrap=True)
item_5 = ListItem(List=item_2, Index="3", Wrap=True)
item_6 = ListItem(List=item_2, Index="4", Wrap=True)
equals = Equality(FirstNumber=item_3, SecondNumber=pick_method)  # -> Equality, Inequality
totalsoundings_pattern = Boolean(simplify(equals.Equality))
depth_in_rock = Data(item_6)
depth_in_soil = Data(item_5)

# ---- group: Check if 3 = conducted or 5 = approved
expression = Expression(x=item_4, Expression="if ((x = 3) or (x = 5), 1, 0)")

# ---- group: Pick Method = Total Sounding & Conducted Status = Approved OR Conducted (continued)
status_pattern = Boolean(simplify(expression))

# ---- group: FIlter selection
location_xyz_points_2 = Data(simplify(location_xyz_points))
totalsoundings_pattern_2 = Boolean(simplify(totalsoundings_pattern))
status_pattern_2 = Boolean(simplify(status_pattern))
depth_base = Data(depth_in_soil)
depth_in_rock_2 = Data(depth_in_rock)
methods_strings_2 = Data(methods_strings)
depth_in_rock_3 = Data(simplify(depth_in_rock_2))
expression_2 = Expression(x=totalsoundings_pattern_2, y=status_pattern_2, Expression="if (x = True AND y = True, 1, 0)")
depth_base_2 = Data(simplify(depth_base))
trim = TrimTree(Tree=totalsoundings_pattern_2, Depth=1)
tstat = TreeStatistics(Tree=trim)  # -> Paths, simplify(graft(Length)), Count
item_7 = ListItem(List=methods_strings_2, Index=0, Wrap=True)  # -> simplify(Item)
repeat = RepeatData(Data=location_id_2, Length=tstat.Length)  # -> simplify(Data)
repeat_2 = RepeatData(Data=name_4, Length=tstat.Length)  # -> simplify(Data)
repeat_3 = RepeatData(Data=location_xyz_points_2, Length=tstat.Length)  # -> simplify(Data)
dispatch = Dispatch(List=item_7, DispatchPattern=expression_2)  # -> ListA, ListB
trim_2 = TrimTree(Tree=expression_2, Depth=1)
dispatch_2 = Dispatch(List=depth_base_2, DispatchPattern=expression_2)  # -> ListA, ListB
dispatch_3 = Dispatch(List=depth_in_rock_3, DispatchPattern=expression_2)  # -> ListA, ListB
trim_3 = TrimTree(Tree=dispatch_2.ListA, Depth=1)
dispatch_4 = Dispatch(List=repeat_2, DispatchPattern=trim_2)  # -> ListA, ListB
dispatch_5 = Dispatch(List=repeat_3, DispatchPattern=trim_2)  # -> ListA, ListB
trim_4 = TrimTree(Tree=dispatch_3.ListA, Depth=1)
trim_5 = TrimTree(Tree=dispatch.ListA, Depth=1)
depth_in_soil_filtered = Data(trim_3)
depth_in_rock_filtered = Data(trim_4)
methods_id_filtered = Data(trim_5)
location_id_filtered = Data(repeat)
locations_filtered = Point(dispatch_5.ListA)
name_filtered = Data(dispatch_4.ListA)

# ---- group: Location Name Display Preview in Rhino Viewport
name_filtered_2 = Data(name_filtered)
# Results
top_points = Point(locations_filtered)
tag = TextTag3D(Location=top_points, Text=name_filtered_2, Size=1, Colour=RGB(0, 0, 0), Justification=5)

# ---- group: Interpolate bedrock mesh & create 3D borehole columns
top_points_2 = Point(locations_filtered)
depth_in_soil_filtered_2 = Data(simplify(depth_in_soil_filtered))
depth_in_rock_filtered_2 = Data(depth_in_rock_filtered)
Z = UnitZ(Factor=depth_in_soil_filtered_2)
Z_2 = UnitZ(Factor=depth_in_rock_filtered_2)
move = Move(Geometry=top_points_2, Motion=expr("-x", Z))  # -> Geometry, Transform
move_2 = Move(Geometry=move.Geometry, Motion=expr("-x", Z_2))  # -> Geometry, Transform
clean = CleanTree(RemoveNulls=True, RemoveInvalid=True, RemoveEmpty=True, Tree=move.Geometry)  # -> flatten(Tree)
ln = Line(StartPoint=top_points_2, EndPoint=move.Geometry)
ln_2 = Line(StartPoint=move.Geometry, EndPoint=move_2.Geometry)
del = DelaunayMesh(Points=clean, Plane=PlaneXY(0, 0, 0))
pipe = Pipe(Curve=ln, Radius=radius_of_3d_column_m, Caps=0)
pipe_2 = Pipe(Curve=ln_2, Radius=0.5, Caps=0)
depth_in_soil_3d = Data(pipe)
depth_in_rock_3d = Data(pipe_2)

# ---- group: Interpolate bedrock mesh & create 3D borehole columns / Should update to not have this component, but it's a bug in the mesh... probably invalid data
mshreduce = MeshReduce(Mesh=del, TargetSize=2000, Distort=True, Accuracy=10, NormalizeSize=False)

# ---- group: Interpolate bedrock mesh & create 3D borehole columns (continued)
mesh = Mesh(mshreduce)

# ---- group: Preview in Rhino Viewport
depth_in_rock_3d_2 = Data(depth_in_rock_3d)
depth_in_soil_3d_2 = Data(depth_in_soil_3d)
mesh_2 = Mesh(mesh)
preview = CustomPreview(Geometry=depth_in_soil_3d_2, Material=ColourSwatch(SwatchColor=RGBA(0, 0, 0, 133)))
preview_2 = CustomPreview(Geometry=mesh_2, Material=ColourSwatch(SwatchColor=RGBA(143, 143, 143, 133)))
preview_3 = CustomPreview(Geometry=depth_in_rock_3d_2, Material=ColourSwatch(SwatchColor=RGBA(186, 0, 0, 133)))

# ==== cluster GETProject_id
external_id = ClusterInput()
token = ClusterInput()

# ---- group: API URL Input
api_url = Panel("https://api.fieldmanager.io/fieldmanager/projects")
url = Data(api_url)

# ----
cqp = CreateQueryParam(Key="limit", Value="10000")

external_id_2 = Data(external_id)
token_2 = Data(token)
ch = CreateHttpHeader(Key="Accept", Value="application/json")
bearer = BearerTokenAuth(Token=token_2)
merge = Merge(Data1=ch, Data2=bearer)
headers = Data(merge)
api_url_2 = Panel(url)
external_id_3 = Data(external_id_2)

# ---- group: API Call
headers_2 = Data(headers)
url_2 = Data(url)

# ----
get = GETRequest(URL=url_2, Params=cqp, Headers=headers_2)  # -> Status, Content, Response
pjs = ParseJSONString(Text=get.Content)
panel = Panel(get.Status)
sjt = SeparateJSONTokens(JTokens=pjs)  # -> JObjects, JArrays, JValues

# ---- group: API Call (continued)
jarrays = Data(sjt.JArrays)
jvalues = Data(sjt.JValues)

# ----
jarrays_2 = Data(jarrays)
rja = ReadJSONArray(Array=jarrays_2)
sjt_2 = SeparateJSONTokens(JTokens=rja)  # -> JObjects, JArrays, JValues
rjo = ReadJSONObject(JObject=sjt_2.JObjects)  # -> Keys, JTokens
panel_2 = Panel("""4
5
3
0""")
rjv = ReadJSONValue(JValue=rjo.JTokens)  # -> AsString, AsNumber, AsBool
item = ListItem(List=rjv.AsString, Index=panel_2, Wrap=True)
project_name = ListItem(List=item, Index=1, Wrap=True)  # -> flatten(Item)
project_id = ListItem(List=item, Index=3, Wrap=True)  # -> flatten(Item)

panel_3 = Panel(rjo.Keys)
external_id_4 = ListItem(List=item, Index=2, Wrap=True)  # -> flatten(Item)
mindex = MemberIndex(Set=external_id_4, Member=external_id_3)  # -> Index, Count
project_idlist = Data(project_id)
project_index = Data(mindex.Index)
item_2 = ListItem(List=project_idlist, Index=project_index, Wrap=True)
project_id_2 = Data(item_2)

project_id_3 = ClusterOutput(project_id_2)

# ==== cluster GETProjectSummary
project_id = ClusterInput()
token = ClusterInput()
project_id_2 = Data(project_id)
token_2 = Data(token)

token_3 = Data(token_2)
ch = CreateHttpHeader(Key="Accept", Value="application/json")
bearer = BearerTokenAuth(Token=token_3)
merge = Merge(Data1=ch, Data2=bearer)
headers = Data(merge)

# ---- group: API URL Input
api_url = Panel("https://api.fieldmanager.io/fieldmanager/projects")
url = Data(api_url)

# ----
url_2 = Data(url)
project_id_3 = Data(project_id_2)

# ---- group: API URL Input
endpoint_name = Panel("summary")
concat = Concatenate(FragmentA=url_2, FragmentB=project_id_3, FragmentC=endpoint_name, JoinSeparator="/")
url_3 = Data(concat)

# ---- group: API Call
url_4 = Data(url_3)
headers_2 = Data(headers)
api_call = APICall(U=url_4, H=headers_2)  # -> ja, jv
jarrays = Data(api_call.ja)
jvalues = Data(api_call.jv)

# ----
jarrays_2 = Data(jarrays)
rja = ReadJSONArray(Array=jarrays_2)
sjt = SeparateJSONTokens(JTokens=rja)  # -> JObjects, JArrays, JValues
rjo = ReadJSONObject(JObject=sjt.JObjects)  # -> Keys, JTokens
rjv = ReadJSONValue(JValue=rjo.JTokens)  # -> AsString, AsNumber, AsBool
item = ListItem(List=rjv.AsString, Index=[0, 1, 2, 3, 4, 5, 6, 7, 8, 9, 10], Wrap=True)

methods_json = Data(rjo.JTokens)
location_keys = Data(rjo.Keys)
location_vals = Data(item)
location_keys_2 = ClusterOutput(location_keys)
location_vals_2 = ClusterOutput(location_vals)
methods_json_2 = ClusterOutput(methods_json)

# ==== cluster UnpackJSON
methods_json = ClusterInput()
methods_json_2 = Data(methods_json)

# ---- group: Methods
sjt = SeparateJSONTokens(JTokens=methods_json_2)  # -> JObjects, JArrays, JValues
rja = ReadJSONArray(Array=sjt.JArrays)
rjo = ReadJSONObject(JObject=rja)  # -> Keys, JTokens
sjt_2 = SeparateJSONTokens(JTokens=rjo.JTokens)  # -> JObjects, JArrays, JValues
rjv = ReadJSONValue(JValue=sjt_2.JValues)  # -> AsString, AsNumber, AsBool
methods_keys = Data(rjo.Keys)
methods_vals = Data(rjv.AsNumber)

# ----
methods_strings = Data(rjv.AsString)
methods_keys_2 = ClusterOutput(methods_keys)
methods_strings_2 = ClusterOutput(methods_strings)
methods_vals_2 = ClusterOutput(methods_vals)

# ==== cluster APICall
U = ClusterInput()
H = ClusterInput()

# ---- group: URL
get = GETRequest(URL=U, Headers=H)  # -> Status, Content, Response

# ----
cluster = Cluster(Panel=get.Status, T=get.Content)  # -> ja, jv
ja = ClusterOutput(cluster.ja)
jv = ClusterOutput(cluster.jv)

# ==== cluster Cluster
T = ClusterInput()
pjs = ParseJSONString(Text=T)
panel = Panel(ClusterInput())
sjt = SeparateJSONTokens(JTokens=pjs)  # -> JObjects, JArrays, JValues
rjo = ReadJSONObject(JObject=sjt.JObjects)  # -> Keys, JTokens
sjt_2 = SeparateJSONTokens(JTokens=rjo.JTokens)  # -> JObjects, JArrays, JValues
ja = ClusterOutput(sjt_2.JArrays)
jv = ClusterOutput(sjt_2.JValues)
